# Grasshopper definition Sphere_with_random_pattern.gh (Grasshopper 1.0.7)

# ----
# Ref.: https://www.youtube.com/watch?v=NWVq7SAe2zI&list=LL&index=129
number_slider = Slider(50, range=0..50)

xy = XYPlane(Origin=Point(0, 0, 0))
subtraction = Subtraction(A=number_slider, B=Slider(30, range=0..50))
sph = Sphere(Base=xy, Radius=number_slider)
Z = UnitZ(Factor=subtraction)
cir = Circle(Plane=PlaneXY(0, 0, 0), Radius=Slider(100, range=0..100))
move = Move(Geometry=sph, Motion=Z)  # -> Geometry, Transform
split = SplitBrep(Brep=move.Geometry, Cutter=cir)
item = ListItem(List=split, Index=0, Wrap=True)
Z_2 = UnitZ(Factor=Slider(68, range=0..100))
move_2 = Move(Geometry=cir, Motion=Z_2)  # -> Geometry, Transform
split_2 = SplitBrep(Brep=item, Cutter=move_2.Geometry)
item_2 = ListItem(List=split_2, Index=1, Wrap=True)
srf = Surface(item_2)
srf_2 = Surface(srf)

number_slider_2 = Slider(160, range=0..1000)

popgeo = PopulateGeometry(Geometry=srf_2, Count=number_slider_2, Seed=1)
random = Random(Range=Slider(500, range=0..1000), Number=Slider(3, range=0..10), Seed=2)
rad = Radians(Degrees=Slider(200, range=0..200))
srf_cp = SurfaceClosestPoint(Point=popgeo, Surface=srf_2)  # -> Point, UVPoint, Distance
random_2 = Random(Range=Domain(0, 1), Number=number_slider_2, Seed=random)  # -> simplify(Random)
random_3 = Random(Range=rad, Number=number_slider_2, Seed=2)
evalsrf = EvaluateSurface(Surface=srf_2, Point=srf_cp.UVPoint)  # -> Point, Normal, UDirection, VDirection, Frame
Z_3 = UnitZ(Factor=Slider(20, range=0..100))
move_3 = Move(Geometry=cir, Motion=Z_3)  # -> Geometry, Transform
bang = ExplodeTree(Data=random_2)  # -> Branch0, Branch1, Branch2
cir_2 = Circle(Plane=PlaneXY(0, 0, 0), Radius=Slider(100, range=0..100))
vec = VectorXYZ(XComponent=bang.Branch0, YComponent=bang.Branch1, ZComponent=bang.Branch2)  # -> Vector, Length
X = UnitX(Factor=1)
rot3d = Rotate3D(Geometry=evalsrf.Frame, Angle=random_3, Center=evalsrf.Frame, Axis=vec.Vector)  # -> Geometry, Transform
edges = BrepEdges(Brep=srf_2)  # -> Naked, Interior, NonManifold
xy_2 = XYPlane(Origin=Point(0, 0, 0))
arrpolar = PolarArray(Geometry=edges.Interior, Plane=xy_2, Count=10, Angle=6.283185307)  # -> Geometry, Transform
sec = BrepPlane(Brep=srf_2, Plane=rot3d.Geometry)  # -> Curves, Points
crv = Curve(edges.Naked)

# ---- group: Membranas arquitetônicas translúcidas
scale = Scale(Geometry=move.Geometry, Center=Point(0, 0, 0), Factor=Slider(0.95, range=0..10))  # -> Geometry, Transform
split_3 = SplitBrep(Brep=scale.Geometry, Cutter=cir)
item_3 = ListItem(List=crv, Index=1, Wrap=True)
item_4 = ListItem(List=split_3, Index=0, Wrap=True)
project = Project(Curve=item_3, Brep=item_4, Direction=Vector(0, 0, 1))
split_4 = SplitBrep(Brep=item_4, Cutter=project)
item_5 = ListItem(List=split_4, Index=1, Wrap=True)
preview = CustomPreview(Geometry=item_5, Material=ColourSwatch(SwatchColor=RGBA(255, 255, 255, 213)))

# ----
srf_3 = Surface(item_5)
project_2 = Project(Curve=move_3.Geometry, Brep=srf_3, Direction=X)
item_6 = ListItem(List=crv, Index=1, Wrap=True)
boundary = BoundarySurfaces(Edges=project_2)
project_3 = Project(Curve=item_6, Brep=boundary, Direction=Vector(0, 0, 1))
split_5 = SplitBrep(Brep=boundary, Cutter=project_3)
item_7 = ListItem(List=split_5, Index=1, Wrap=True)
area = Area(Geometry=boundary)  # -> Area, Centroid
pipe = Pipe(Curve=[crv, arrpolar.Geometry], Radius=Slider(0.35, range=0..1.1), Caps=0)  # disabled
pipe_2 = Pipe(Curve=sec.Curves, Radius=Slider(0.15, range=0..10), Caps=0)  # disabled
swatch = ColourSwatch(SwatchColor=RGB(191, 227, 32))  # disabled
preview_2 = CustomPreview(Geometry=[pipe, pipe_2], Material=swatch)  # disabled

# ---- group: Dimensão em metros
number_slider_3 = Slider(50, range=0..50)  # disabled
number_slider_4 = Slider(30, range=0..50)  # disabled

# ----
number_slider_5 = Slider(100, range=0..100)  # disabled
xy_3 = XYPlane(Origin=Point(0, 0, 0))  # disabled
subtraction_2 = Subtraction(A=number_slider_3, B=number_slider_4)  # disabled
number_slider_6 = Slider(10, range=0..10)  # disabled
sph_2 = Sphere(Base=xy_3, Radius=number_slider_3)  # disabled
number_slider_7 = Slider(70, range=0..100)  # disabled
number_slider_8 = Slider(40, range=0..100)  # disabled
Z_4 = UnitZ(Factor=subtraction_2)  # disabled
cir_3 = Circle(Plane=PlaneXY(0, 0, 0), Radius=number_slider_5)  # disabled
move_4 = Move(Geometry=sph_2, Motion=Z_4)  # -> Geometry, Transform; disabled
neg = Negative(Value=number_slider_7)  # disabled
addition = Addition(A=number_slider_5, B=number_slider_6)  # disabled
split_6 = SplitBrep(Brep=move_4.Geometry, Cutter=cir_3)  # disabled
number_slider_9 = Slider(200, range=0..200)  # disabled
pt = ConstructPoint(XCoordinate=addition, YCoordinate=0, ZCoordinate=0)  # disabled
pt_2 = ConstructPoint(XCoordinate=neg, YCoordinate=0, ZCoordinate=number_slider_8)  # disabled
item_8 = ListItem(List=split_6, Index=0, Wrap=True)  # disabled
panel = Panel(split_6)  # disabled
number_slider_10 = Slider(0, range=0..100)  # disabled
number_slider_11 = Slider(0.94, range=0..5)  # disabled
line = LineSDL(Start=pt, Direction=pt_2, Length=number_slider_9)  # disabled
srf_4 = Surface(item_8)  # disabled
scx = SurfaceCurve(Surface=srf_4, Curve=line)  # -> Curves, Points, UVPoints, Normals, Parameters, Tangents; disabled
pt_3 = ConstructPoint(XCoordinate=number_slider_10, YCoordinate=number_slider_11, ZCoordinate=0)  # disabled
panel_2 = Panel(scx.Tangents)  # disabled
evalsrf_2 = EvaluateSurface(Surface=reparameterize(srf_4), Point=pt_3)  # -> Point, Normal, UDirection, VDirection, Frame; disabled
number_slider_12 = Slider(20, range=0..20)  # disabled
evalsrf_3 = EvaluateSurface(Surface=reparameterize(srf_4), Point=scx.UVPoints)  # -> Point, Normal, UDirection, VDirection, Frame; disabled
panel_3 = Panel(evalsrf_2.Normal)  # disabled
cir_4 = Circle(Plane=evalsrf_3.Frame, Radius=number_slider_12)  # disabled
project_4 = Project(Curve=cir_4, Brep=item_8, Direction=evalsrf_2.Normal)  # -> flatten(Curve); disabled
number_slider_13 = Slider(0, range=0..1)  # disabled
number_slider_14 = Slider(100, range=0..100)  # disabled
number_slider_15 = Slider(500, range=0..1000)  # disabled
number_slider_16 = Slider(3, range=0..10)  # disabled
srfsplit = SurfaceSplit(Surface=srf_4, Curves=project_4)  # disabled
item_9 = ListItem(List=srfsplit, Index=number_slider_13, Wrap=True)  # disabled
rad_2 = Radians(Degrees=number_slider_14)  # disabled
number_slider_17 = Slider(160, range=0..1000)  # disabled
random_4 = Random(Range=number_slider_15, Number=number_slider_16, Seed=2)  # disabled
random_5 = Random(Range=Domain(0, 1), Number=number_slider_17, Seed=random_4)  # -> simplify(Random); disabled
random_6 = Random(Range=rad_2, Number=number_slider_17, Seed=2)  # disabled
srf_5 = Surface(item_9)  # disabled
popgeo_2 = PopulateGeometry(Geometry=srf_5, Count=number_slider_17, Seed=1)  # disabled
srf_cp_2 = SurfaceClosestPoint(Point=popgeo_2, Surface=srf_5)  # -> Point, UVPoint, Distance; disabled
evalsrf_4 = EvaluateSurface(Surface=srf_5, Point=srf_cp_2.UVPoint)  # -> Point, Normal, UDirection, VDirection, Frame; disabled
bang_2 = ExplodeTree(Data=random_5)  # -> Branch0, Branch1, Branch2; disabled
vec_2 = VectorXYZ(XComponent=bang_2.Branch0, YComponent=bang_2.Branch1, ZComponent=bang_2.Branch2)  # -> Vector, Length; disabled
rot3d_2 = Rotate3D(Geometry=evalsrf_4.Frame, Angle=random_6, Center=evalsrf_4.Frame, Axis=vec_2.Vector)  # -> Geometry, Transform; disabled
edges_2 = BrepEdges(Brep=srf_5)  # -> Naked, Interior, NonManifold; disabled
number_slider_18 = Slider(0.05, range=0..0.1)  # disabled
number_slider_19 = Slider(2, range=0..10)  # disabled
number_slider_20 = Slider(0.2, range=0.02..0.5)  # disabled
sec_2 = BrepPlane(Brep=srf_5, Plane=rot3d_2.Geometry)  # -> Curves, Points; disabled
number_slider_21 = Slider(2, range=0..10)  # disabled
crv_2 = Curve(edges_2.Naked)  # disabled
pipe_3 = Pipe(Curve=crv_2, Radius=number_slider_18, Caps=number_slider_19)  # disabled
pipe_4 = Pipe(Curve=sec_2.Curves, Radius=number_slider_20, Caps=number_slider_21)  # disabled
merge = Merge(Data1=pipe_3)  # disabled
